# Grasshopper definition ReleaseGHdata.gh (Grasshopper 1.0.7)
# plug-ins: MISE

h_shape = MakeHShapeModel(
    Width=Slider(100, range=0..100),
    Height=Slider(200, range=0..1000),
    WebThickness=Slider(5.5, range=0..10),
    FlangeThickness=Slider(8, range=0..10),
    F=Slider(235, range=0..1000),
    Length=Slider(6000, range=0..10000))  # -> AnalysisParametar, ViewModelSurface
trapezoid_l = TrapezoidLoad(
    AnalysisParametar=h_shape.AnalysisParametar,
    TrapezoidLoad=Slider(10, range=0..10),
    DWidth=Slider(1800, range=0..10000),
    Lb=Slider(3000, range=0..10000),
    YoungsModulus=205000)  # -> BendingMoment, BendingStress, AllowableBendingStress, ExaminationResult, Deformation
panel = Panel([trapezoid_l.BendingStress, trapezoid_l.AllowableBendingStress, trapezoid_l.ExaminationResult, trapezoid_l.Deformation])
moment = MomentView(Moment=trapezoid_l.BendingMoment, Scale=10)
